# Grasshopper definition animation_piton.ghx (Grasshopper 0.9.14)

int = Integer("200")
interval = Domain(int)
timer = Timer(TimerInterval=60, Target=c_script)
c_script = CSharpScript(interval=interval, reset=Toggle(False))  # -> out, B, C; inputs reset: Boolean
# ---------- c_script: C# ----------
    if(!reset){
      c++;
    }else{
      c = -1;
    }
    c = (int)(c%(interval.Max + 1));
    if(c >= interval.Min && c <= interval.Max){
      B = true;
    }else{
      B = false;
    }


    C = c;
# ---------- c_script: C# additional code ----------
  int c = -1;
# ---------- end c_script ----------
receiver = Receiver(c_script.B, DrawTag=True, DrawWires=2)
receiver_2 = Receiver(c_script.C, DrawTag=True, DrawWires=2)
division = Division(A=c_script.C, B=int)
cir = Circle(Plane=PlaneXY(0, 0, 0), Radius=20)
eval = EvaluateLength(Curve=cir, Length=division, Normalized=True)  # -> Point, Tangent, Parameter
gradient = Gradient(
    LowerLimit=0,
    UpperLimit=1,
    Parameter=division,
    stops=[0: RGB(128, 128, 255), 0.473: RGB(255, 255, 0), 1: RGB(128, 128, 255)])
gradient_2 = Gradient(LowerLimit=0, UpperLimit=1, Parameter=division, stops=[0: RGB(255, 0, 0), 0.473: RGB(255, 255, 0), 1: RGB(255, 0, 0)])
cir_2 = Circle(Plane=eval.Point, Radius=20)
eval_2 = EvaluateLength(Curve=cir_2, Length=expr("1-L", division), Normalized=True)  # -> Point, Tangent, Parameter
sph = Sphere(Base=[eval_2.Point, eval.Point], Radius=2)
material = CreateMaterial(Diffuse=[gradient, gradient_2], Specular=RGB(255, 255, 255), Emission=RGB(0, 0, 0), Transparency=0, Shine=0)
panel = Panel("D:\aab\")
c_script_2 = CSharpScript()  # -> out; inputs geometry: list of GeometryBase, material: list, layers: list of String, activate: Boolean, current: Int32, filePath: String
# ---------- c_script_2: C# ----------
    if(!activate) return;

    List<Guid> guids = new List<Guid>();

    for(int i = 0; i < geometry.Count; i++){

      Rhino.DocObjects.ObjectAttributes att = new Rhino.DocObjects.ObjectAttributes();

      Rhino.Display.DisplayMaterial shader = new Rhino.Display.DisplayMaterial();

      if(material.Count == geometry.Count){
        shader = (Rhino.Display.DisplayMaterial) material[i];
      }else if(material.Count > 0){
        shader = (Rhino.Display.DisplayMaterial) material[0];
      }

      Rhino.DocObjects.Material mat = new Rhino.DocObjects.Material();

      mat.AmbientColor = shader.Ambient;
      mat.DiffuseColor = shader.Diffuse;
      mat.EmissionColor = shader.Emission;
      mat.Shine = shader.Shine;
      mat.SpecularColor = shader.Specular;
      mat.Transparency = shader.Transparency;

      string shaderName = string.Format("D{0}-E{1}-S{2}-Sp{3}-T{4}",
        shader.Diffuse.Name,
        shader.Emission.Name,
        shader.Shine,
        shader.Specular,
        shader.Transparency
        );

      mat.Name = shaderName;

      int nwMat = doc.Materials.Find(shaderName, true);
      if(nwMat < 0) nwMat = doc.Materials.Add(mat);

      Print(nwMat.ToString());

      string layer = "";

      if(layers.Count == geometry.Count){
        layer = layers[i];
      }else if(layers.Count > 0){
        layer = layers[0];
      }

      if(layer.Length == 0){
        att.MaterialSource = Rhino.DocObjects.ObjectMaterialSource.MaterialFromObject;
        att.MaterialIndex = nwMat;
        att.LayerIndex = doc.Layers.Find(doc.Layers.CurrentLayer.Id, true);
      }else{
        att.MaterialSource = Rhino.DocObjects.ObjectMaterialSource.MaterialFromLayer;
        int layInd = doc.Layers.Find(layer, true);
        if(layInd < 0){
          Rhino.DocObjects.Layer l = new Rhino.DocObjects.Layer();
          l.Color = mat.DiffuseColor;
          l.Name = layer;
          l.RenderMaterialIndex = nwMat;
          layInd = doc.Layers.Add(l);
        }
        att.LayerIndex = layInd;
      }

      Guid id = Guid.Empty;

      if(geometry[i].ObjectType == Rhino.DocObjects.ObjectType.Brep) id = doc.Objects.AddBrep((Brep) geometry[i], att);
      if(geometry[i].ObjectType == Rhino.DocObjects.ObjectType.Surface) id = doc.Objects.AddSurface((Surface) geometry[i], att);
      if(geometry[i].ObjectType == Rhino.DocObjects.ObjectType.Mesh) id = doc.Objects.AddMesh((Mesh) geometry[i], att);

      if(id.ToString().Length > 0) guids.Add(id);

    }

    string savedLocation = filePath + "\\r" + current.ToString("0000000") + ".png";

    Rhino.RhinoApp.RunScript("_-Render", false);
    //Rhino.RhinoApp.RunScript("_-SaveRenderWindowAs \n\"" + savedLocation + "\"\n", false);
    Rhino.RhinoApp.RunScript("_-CloseRenderWindow", false);

    for(int i = 0; i < guids.Count; i++) doc.Objects.Delete(guids[i], true);
# ---------- end c_script_2 ----------
